# Grasshopper definition 09_json_to_grasshopper.gh (Grasshopper 1.0.8)

panel = Panel("C:\Users\Ardo\Desktop\thesis\street_geo_with_mrt.json")
python_3_script = Python3Script(folder_path="C:\Users\Ardo\Desktop\thesis\post_processed", index=Slider(952, range=0..952))  # -> out, selected_file, data, file_count; inputs folder_path: String, index: Int32
# ---------- python_3_script: Python ----------
import os
import json

# === List all JSON files in folder
all_files = sorted([
    f for f in os.listdir(folder_path)
    if f.endswith(".json")
])

# === Total file count
file_count = len(all_files)

# === Handle slider index safely
index = 0 if index is None else int(index)
index = max(0, min(index, file_count - 1))

# === Select and load file
selected_file = os.path.join(folder_path, all_files[index])
with open(selected_file, "r") as f:
    data = json.load(f)

# === Outputs
a = selected_file     # File path
b = data              # JSON content
c = file_count        # Total number of JSON files
# ---------- end python_3_script ----------
panel_2 = Panel(python_3_script.file_count)
python_3_script_2 = Python3Script(json_path=python_3_script.selected_file)  # -> out, a, b, c
# ---------- python_3_script_2: Python ----------
import json
from Rhino.Geometry import Point3d, Polyline, PolylineCurve, Surface, Vector3d, Brep

# === Load the JSON file
with open(json_path, "r") as f:
    data = json.load(f)

# === Helper to convert 2D point to Point3d
def to_point3d(p):
    return Point3d(p[0], p[1], 0)

# === Street geometry
street_pts = [to_point3d(p) for p in data.get("street", [])]
if street_pts and street_pts[0] != street_pts[-1]:
    street_pts.append(street_pts[0])
street_poly = PolylineCurve(Polyline(street_pts)) if street_pts else None

# === Building outlines and capped volumes
building_curves = []
building_solids = []

for b in data.get("buildings", []):
    footprint = b.get("footprint", [])
    height = b.get("height", 0)

    if len(footprint) >= 3:
        pts = [to_point3d(p) for p in footprint]
        if pts[0] != pts[-1]:
            pts.append(pts[0])
        poly = Polyline(pts)
        curve = PolylineCurve(poly)
        building_curves.append(curve)

        # Extrude as surface
        direction = Vector3d(0, 0, height)
        surface = Surface.CreateExtrusion(curve, direction)
        if surface:
            brep = surface.ToBrep()
            if brep:
                # Cap planar holes to make it a solid
                capped = brep.CapPlanarHoles(1e-6)
                if capped:
                    building_solids.append(capped)

# === Outputs
a = street_poly        # Street polyline
b = building_curves    # Building outlines
c = building_solids    # Capped building Breps (solids)
# ---------- end python_3_script_2 ----------
brep = Brep(python_3_script_2.a)
brep_2 = Brep(python_3_script_2.b)
brep_3 = Brep(python_3_script_2.c)
